vi "Main.gvi"   [LabVIEW NXG 5.0.0]
# This template is for the Queued Message Handler design pattern.
# The Event Handling Loop generates messages based on user interface actions.
# The Message Handling Loop processes messages generated by the Event Handling Loop, or by other messages.  The messages are string values, so new messages can be added easily to the Message Cases case structure in the Message Handling Loop.  Each message cluster can also provide an optional value for Message Data, which is a variant that can be converted to whatever message-specific data is required.
panel controls:
  "Exit": bool
  "TEMP Button": bool
  "LUX Button": bool
  "VISA Resource Name": "VISA Instr" = "COM5"
  "Initialize VISA": bool
  "CMD Button": bool
  "Initialize AI": bool
  "PV Config Button": bool
  "Set PV Angle Button": bool
  "IR Thermometer Config Button": bool
  "Fans Button": bool
  "Brightness Config Button": bool
  "Optic Filter Config Button": bool
  "Reset CVM Button": bool
  "Stop": bool
  "PV Config Selector": string
  "PV Angle": i32
  "Fans Selector": string
  "Optic Filter Selector": string
  "IR Thermometer Selector": string
  "Brightness": i32
  "Prepare CVM Button": bool
  "write buffer": string = "@DO 34 0#"
  "Set Resistance Button": bool
  "Reset Resistance Button": bool
  "Resistance String": string
  "VAC Button": bool
panel indicators:
  "Display": string
  "CMD": "TAG.gtype"
  "LUX_2": "TAG.gtype"
  "TEMP_2": "TAG.gtype"
  "Chart": waveform<f64>[]
  "Maсhine State": string
  "Voltage Range": f64
  "Voltage coeff": f64
  "Current coeff": f64
  "V_real": f64
  "Current_real": f64
  "VAC Load Counter": i32
  "Voltage_Graph": f64[]
  "Output": error
  "VISA Answer_2": "TAG.gtype"[]
  "VISA Answer": "TAG.gtype"[]
  "Current_Graph": f64[]
  "Graph_3": cluster{"Element 1": f64[], "Element 2": f64[]}
types:
  "TAG.gtype" = cluster{"Timestamp": timestamp, "DATA": string}
  "DataType.gtype" = enum{"Double", "I32", "String", "Boolean", "U64", "Timestamp"}
  "Tag.gtype" = cluster{"Path": string, "Datatype": "DataType.gtype", "Configuration": "Configuration.gtype"}
  "Client Handle.gtype" = u32
  "Configuration.gtype" = cluster{"Server URL": string, "Session": "Client Handle.gtype", "Raw Session Queue": Queue<"Client Handle.gtype">}
  T1 = cluster{"VISA Resource": "VISA Instr", "Physical Channel": "DAQmx Task", "tag": "Tag.gtype", "configuration": "Configuration.gtype"}
  "UI Data.gtype" = cluster{"Boolean <Replace Me>": bool, "String <Replace Me>": string, "Numeric <Replace Me>": f64}
  "ValueRange.gtype" = cluster{"maximum value": f64, "minimum value": f64}
uses:
  Message Queue::Create All Message Queues.gvi
  Message Queue::Enqueue Message (Single).gvi
  Support::Error Handler - Event Handling Loop.gvi
  Message Queue::Dequeue Message.gvi
  NI::VISA::Configure Serial Port (Instr).gvi
  NI::VISA::Open (Instr).gvi
  NI::Skyline::Configuration::Open Configuration API Key.gvi
  NI::Skyline::TagHTTP::Open Tag.gvi
  NI::DAQmx::Internal::DAQmx Create Channel (AI-Voltage-Basic).gvi
  Queued Message Handler::Read_Write_VISA.gvi
  Queued Message Handler::PV_switch.gvi
  Queued Message Handler::CMD_Iteration.gvi
  NI::DAQmx::Internal::DAQmx Read (Analog 2D DBL NChan NSamp).gvi
  NI::DAQmx::Internal::DAQmx Read (Analog 1D Wfm NChan NSamp).gvi
  NI::G Core::Error::Display Error.gvi
  NI::Skyline::Configuration::Close Configuration.gvi
  NI::Skyline::TagHTTP::Close Tag (Single).gvi
  NI::DAQmx::Internal::DAQmx Stop Task.gvi
  NI::VISA::Close (Instr).gvi
  NI::G Core::Error::Build Error Cluster.gvi
  Support::Error Handler - Message Handling Loop.gvi
  NI::Vision::IMAQdx::Initialize.gvi
  NI::Vision::IMAQdx::Configure Grab.gvi
  NI::Vision::Core::Basics::Create Image.gvi
  NI::Vision::IMAQdx::Grab.gvi
  NI::Vision::IMAQdx::Close.gvi
diagram:
  disable {
    frame Enabled { }
    frame Disabled {
      Destroy User Event()
    }
  }
  w1 = bool FALSE  # Stop Event
  Create User Event[EventName="Stop Event"](user event data type=w1) -> (error out=w2, user event out=w3)
  Register For Events("Stop Event"=w3) -> (event registration refnum out=w4)
  call "Create All Message Queues.gvi"(error in=w2) -> (message queues=w5, error out=w6)
  Property Node(instance in=w5) -> ("UI"=w7)
  s1 = w4  # shift register
  while {
    event (dynamic events = s1) {
      on "TEMP Button" Value changed {
        call "Enqueue Message (Single).gvi"(message queue in=w7, message="Get Temperature") -> (message queue out=w10, error out=w9)
        w8 = default
      }
      on "LUX Button" Value changed {
        call "Enqueue Message (Single).gvi"(message queue in=w7, message="Get Brightness") -> (message queue out=w10, error out=w9)
        w8 = default
      }
      on "Exit" Value changed {
        call "Enqueue Message (Single).gvi"(priority message=TRUE, message queue in=w7, message="Exit") -> (message queue out=w10, error out=w9)
        w8 = default
      }
      on dynamic event 0 {
        $Display <- "\"Exit\" button pressed"
        w8 = TRUE
        w9 = default
        w10 = w7
      }
      on "Window" Close? {
        call "Enqueue Message (Single).gvi"(priority message=TRUE, message queue in=w7, message="Exit") -> (message queue out=w10)
        Event Filter("Discard?"=TRUE)
        w8 = default
        w9 = default
      }
      on "Initialize VISA" Value changed {
        call "Enqueue Message (Single).gvi"(message queue in=w7, message="Initialize VISA") -> (message queue out=w10, error out=w9)
        w8 = default
      }
      on "CMD Button" Value changed {
        call "Enqueue Message (Single).gvi"(message queue in=w7, message="Send CMD") -> (message queue out=w10, error out=w9)
        w8 = default
      }
      on "Reset CVM Button" Value changed {
        call "Enqueue Message (Single).gvi"(message queue in=w7, message="Reset CVM") -> (message queue out=w10, error out=w9)
        w8 = default
      }
      on "Initialize AI" Value changed {
        call "Enqueue Message (Single).gvi"(message queue in=w7, message="Initialize AI") -> (message queue out=w10, error out=w9)
        w8 = default
      }
      on "PV Config Button" Value changed {
        call "Enqueue Message (Single).gvi"(message queue in=w7, message="PV Config", message data=$"PV Config Selector") -> (message queue out=w10, error out=w9)
        w8 = default
      }
      on "Set PV Angle Button" Value changed {
        call "Enqueue Message (Single).gvi"(message queue in=w7, message="Set PV Angle", message data=$"PV Angle") -> (message queue out=w10, error out=w9)
        w8 = default
      }
      on "IR Thermometer Config Button" Value changed {
        call "Enqueue Message (Single).gvi"(message queue in=w7, message="IR Thermometer", message data=$"IR Thermometer Selector") -> (message queue out=w10, error out=w9)
        w8 = default
      }
      on "Fans Button" Value changed {
        call "Enqueue Message (Single).gvi"(message queue in=w7, message="Fans Control", message data=$"Fans Selector") -> (message queue out=w10, error out=w9)
        w8 = default
      }
      on "Brightness Config Button" Value changed {
        call "Enqueue Message (Single).gvi"(message queue in=w7, message="Brightness Config", message data=$Brightness) -> (message queue out=w10, error out=w9)
        w8 = default
      }
      on "Optic Filter Config Button" Value changed {
        call "Enqueue Message (Single).gvi"(message queue in=w7, message="Optic Filter Config", message data=$"Optic Filter Selector") -> (message queue out=w10, error out=w9)
        w8 = default
      }
      on "Prepare CVM Button" Value changed {
        call "Enqueue Message (Single).gvi"(message queue in=w7, message="Prepare CVM") -> (message queue out=w10, error out=w9)
        w8 = default
      }
      on "Set Resistance Button" Value changed {
        call "Enqueue Message (Single).gvi"(message queue in=w7, message="Set Resistance", message data=$"Resistance String") -> (message queue out=w10, error out=w9)
        w8 = default
      }
      on "Reset Resistance Button" Value changed {
        call "Enqueue Message (Single).gvi"(message queue in=w7, message="Reset Resistance") -> (message queue out=w10, error out=w9)
        w8 = default
      }
      on "VAC Button" Value changed {
        Property Node(instance in=reference to "Graph_3")
        Get Current Time() -> (current time=w11)
        call "Enqueue Message (Single).gvi"(message queue in=w7, message="VAC", message data=w11) -> (message queue out=w10)
        $"VAC Load Counter" <- 0
        w8 = default
        w9 = default
      }
    }
    call "Error Handler - Event Handling Loop.gvi"(message queue in=w10, error in=w9) -> (dup error in=w12)
    stop if w8
  }
  Unregister For Events(error in=w12, event registration refnum=s1)
  w13 = T1 {"VISA Resource"="COM5", "Physical Channel"="", "tag"={"Path"="", "Datatype"="Double", "Configuration"={"Server URL"="", "Session"=0, "Raw Session Queue"=refnum}}, "configuration"={"Server URL"="", "Session"=0, "Raw Session Queue"=refnum}}
  s2 = "UI Data.gtype" {all zero or empty}  # shift register
  s3 = w13  # shift register
  while {
    call "Dequeue Message.gvi"(message queue in=w7, error in=w6) -> (message queue out=w14, message=w15, message data=w16, error out=w17)
    $"Maсhine State" <- w15
    # s2: Data
    # w3: Stop Event
    case (w15) ignore case {  # Message Cases
      frame "Initialize" {
        # set time
        call "Enqueue Message (Single).gvi"(message queue in=w14, message="Initialize VISA", error in=w17) -> (message queue out=w22, error out=w23)
        call "Enqueue Message (Single).gvi"(message queue in=w22, message="Initialize AI", error in=w23) -> (message queue out=w24, error out=w25)
        call "Enqueue Message (Single).gvi"(message queue in=w24, message="Reset CVM", error in=w25) -> (message queue out=w26, error out=w27)
        call "Enqueue Message (Single).gvi"(message queue in=w26, message="Fans Control", message data="Turn All Off", error in=w27) -> (message queue out=w28, error out=w29)
        call "Enqueue Message (Single).gvi"(message queue in=w28, message="Optic Filter Config", message data="None", error in=w29) -> (message queue out=w30, error out=w31)
        call "Enqueue Message (Single).gvi"(message queue in=w30, message="Set PV Angle", message data="90", error in=w31) -> (message queue out=w32, error out=w33)
        call "Enqueue Message (Single).gvi"(message queue in=w32, message="PV Config", message data="Parallel 4", error in=w33) -> (message queue out=w34, error out=w35)
        call "Enqueue Message (Single).gvi"(message queue in=w34, message="Wait For Event", error in=w35) -> (error out=w18)
        w19 = s2
        w20 = default
        w21 = s3
      }
      frame "Wait For Event" {
        call "Enqueue Message (Single).gvi"(message queue in=w14, message="Watchdog", error in=w17) -> (error out=w18)
        w19 = s2
        w20 = default
        w21 = s3
      }
      frame "Initialize VISA" {
        call "Configure Serial Port (Instr).gvi"(stop bits="1.0"(10), session in=$"VISA Resource Name", baud rate=115200, parity="None"(0), termination char=0xA, enable termination char=TRUE) -> (session out=w36, error out=w37)
        call "Open (Instr).gvi"(resource name=w36, error in=w37) -> (session out=w38, error out=w39)
        Property Node(instance in=s3, "VISA Resource"=w38) -> (instance out=w21)
        Wait(time to wait=2000)
        Merge Errors(w39, w17) -> (error out=w18)
        w19 = s2
        w20 = default
      }
      frame "Initialize SLC" {
        call "Open Configuration API Key.gvi"(server url="https://api.systemlinkcloud.com/", api key="zYUbuW0YNkg1G__lXfJiGVBNWME-HlVd2a5NUHp-IP") -> (configuration=w40, error out=w41)
        call "Open Tag.gvi"(path="LabRaOn", data type="String", error in=w41, configuration=w40) -> (tag=w42, error out=w43)
        # Сделать регулярное сообщение о подключённой установке
        Property Node(instance in=s3, "tag"=w42, "configuration"=w40) -> (instance out=w21)
        Wait(time to wait=2000)
        Merge Errors(w43, w17) -> (error out=w18)
        w19 = s2
        w20 = default
      }
      frame "Initialize AI" {
        call "DAQmx Create Channel (AI-Voltage-Basic).gvi"(physical channels="Dev1/ai0:1,Dev1/ai3,Dev1/ai7", units="Volts"(10348), measurement range="ValueRange.gtype" {"maximum value"=10, "minimum value"=0}, input terminal configuration="RSE"(10083)) -> (task out=w44, error out=w45)
        Property Node(instance in=s3, "Physical Channel"=w44) -> (instance out=w21)
        Merge Errors(w45, w17) -> (error out=w18)
        w19 = s2
        w20 = default
      }
      frame "Send CMD" {
        Property Node(instance in=s3) -> ("VISA Resource"=w46, instance out=w21)
        call "Read_Write_VISA.gvi"(VISA_IN=w46, CMD=$"write buffer", ERROR_IN=w17) -> (TAG=w47, ERROR_OUT=w48)
        $CMD <- w47
        call "Enqueue Message (Single).gvi"(message queue in=w14, message="Wait For Event", error in=w48) -> (error out=w18)
        w19 = s2
        w20 = default
      }
      frame "PV Config" {
        Property Node(instance in=s3) -> ("VISA Resource"=w49, instance out=w21)
        Variant To Data(error in (no error)=w17, type=string "", variant=w16) -> (data=w50, error out=w51)
        call "PV_switch.gvi"(VISA_IN=w49, CTRL="Disconnect", ERROR_IN=w51) -> (VISA_OUT=w52, ERROR_OUT=w53)
        case (w50) {
          frame "Single", Default {
            w56 = ["@DO 17 0#", "@DO 18 1#", "@DO 23 1#", "@DO 24 1#", "@DO 25 1#", "@DO 26 0#", "@DO 27 0#", "@DO 28 0#", "@DO 29 1#", "@DO 30 1#", "@DO 31 1#", "@DO 32 1#", "@DO 33 0#"]
            w57 = ["@DO 54 1#", "@DO 55 1#", "@DO 56 1#", "@DO 57 1#", "@DO 58 1#", "@DO 59 1#", "@DO 60 1#", "@DO 61 1#"]
            # @DO 17 0#
            # @DO 18 1#
            # @DO 23 1#
            # @DO 24 1#
            # @DO 25 1#
            # @DO 26 0#
            # @DO 27 0#
            # @DO 28 0#
            # @DO 29 1#
            # @DO 30 1#
            # @DO 31 1#
            # @DO 32 1#
            # @DO 33 0#
            #
            # 03,08,2020
            # 19:51
            Insert Into Array(inArray=w56, new=w57) -> w58
            call "CMD_Iteration.gvi"(VISA_IN=w52, ARRAY_IN=w58, ERROR_IN=w53) -> (VISA Answer=w55, ERROR_OUT=w54)
          }
          frame "Parallel 2" {
            # @DO 17 1#
            # @DO 18 0#
            # @DO 23 1#
            # @DO 24 0#
            # @DO 25 1#
            # @DO 26 1#
            # @DO 27 1#
            # @DO 28 1#
            # @DO 29 1#
            # @DO 30 1#
            # @DO 31 1#
            # @DO 32 1#
            # @DO 33 1#
            #
            # 03.08.2020
            # 19.53
            w59 = ["@DO 17 1#", "@DO 18 0#", "@DO 23 1#", "@DO 24 0#", "@DO 25 1#", "@DO 26 1#", "@DO 27 1#", "@DO 28 1#", "@DO 29 1#", "@DO 30 1#", "@DO 31 1#", "@DO 32 1#", "@DO 33 1#"]
            # Disconnect all Diodes
            w60 = ["@DO 54 1#", "@DO 55 1#", "@DO 56 1#", "@DO 57 1#", "@DO 58 1#", "@DO 59 1#", "@DO 60 1#", "@DO 61 1#"]
            Insert Into Array(inArray=w59, new=w60) -> w61
            call "CMD_Iteration.gvi"(VISA_IN=w52, ARRAY_IN=w61, ERROR_IN=w53) -> (VISA Answer=w55, ERROR_OUT=w54)
          }
          frame "Parallel 2 Diode" {
            # @DO 17 1#
            # @DO 18 0#
            # @DO 23 1#
            # @DO 24 0#
            # @DO 25 1#
            # @DO 26 1#
            # @DO 27 1#
            # @DO 28 1#
            # @DO 29 1#
            # @DO 30 1#
            # @DO 31 1#
            # @DO 32 1#
            # @DO 33 1#
            #
            # 03.08.2020
            # 19.54
            w62 = ["@DO 17 1#", "@DO 18 0#", "@DO 23 1#", "@DO 24 0#", "@DO 25 1#", "@DO 26 1#", "@DO 27 1#", "@DO 28 1#", "@DO 29 1#", "@DO 30 1#", "@DO 31 1#", "@DO 32 1#", "@DO 33 1#"]
            # @DO 56 0#
            # @DO 57 0#
            #
            # 19.54
            w63 = ["@DO 54 1#", "@DO 55 1#", "@DO 56 0#", "@DO 57 0#", "@DO 58 1#", "@DO 59 1#", "@DO 60 1#", "@DO 61 1#"]
            Insert Into Array(inArray=w62, new=w63) -> w64
            call "CMD_Iteration.gvi"(VISA_IN=w52, ARRAY_IN=w64, ERROR_IN=w53) -> (VISA Answer=w55, ERROR_OUT=w54)
          }
          frame "Series 2" {
            # @DO 17 0#
            # @DO 18 1#
            # @DO 23 1#
            # @DO 24 0#
            # @DO 25 1#
            # @DO 26 1#
            # @DO 27 1#
            # @DO 28 1#
            # @DO 29 0#
            # @DO 30 1#
            # @DO 31 1#
            # @DO 32 0#
            # @DO 33 0#
            #
            # 03.08.2020
            # 19.55
            w65 = ["@DO 17 0#", "@DO 18 1#", "@DO 23 1#", "@DO 24 0#", "@DO 25 1#", "@DO 26 1#", "@DO 27 1#", "@DO 28 1#", "@DO 29 0#", "@DO 30 1#", "@DO 31 1#", "@DO 32 0#", "@DO 33 0#"]
            w66 = ["@DO 54 1#", "@DO 55 1#", "@DO 56 1#", "@DO 57 1#", "@DO 58 1#", "@DO 59 1#", "@DO 60 1#", "@DO 61 1#"]
            Insert Into Array(inArray=w65, new=w66) -> w67
            call "CMD_Iteration.gvi"(VISA_IN=w52, ARRAY_IN=w67, ERROR_IN=w53) -> (VISA Answer=w55, ERROR_OUT=w54)
          }
          frame "Series 2 Diode" {
            # @DO 17 0#
            # @DO 18 1#
            # @DO 23 1#
            # @DO 24 0#
            # @DO 25 1#
            # @DO 26 1#
            # @DO 27 1#
            # @DO 28 1#
            # @DO 29 0#
            # @DO 30 1#
            # @DO 31 1#
            # @DO 32 0#
            # @DO 33 0#
            #
            # 03.08.2020
            # 19.57
            w68 = ["@DO 17 0#", "@DO 18 1#", "@DO 23 1#", "@DO 24 0#", "@DO 25 1#", "@DO 26 1#", "@DO 27 1#", "@DO 28 1#", "@DO 29 0#", "@DO 30 1#", "@DO 31 1#", "@DO 32 0#", "@DO 33 0#"]
            # @DO 60 0#
            # @DO 61 0#
            #
            # 03.08.2020
            w69 = ["@DO 54 1#", "@DO 55 1#", "@DO 56 1#", "@DO 57 1#", "@DO 58 1#", "@DO 59 1#", "@DO 60 0#", "@DO 61 0#"]
            Insert Into Array(inArray=w68, new=w69) -> w70
            call "CMD_Iteration.gvi"(VISA_IN=w52, ARRAY_IN=w70, ERROR_IN=w53) -> (VISA Answer=w55, ERROR_OUT=w54)
          }
          frame "Parallel 4" {
            # @DO 17 1#
            # @DO 18 1#
            # @DO 23 1#
            # @DO 24 1#
            # @DO 25 1#
            # @DO 26 1#
            # @DO 27 1#
            # @DO 28 1#
            # @DO 29 1#
            # @DO 30 1#
            # @DO 31 1#
            # @DO 32 1#
            # @DO 33 1#
            #
            # 03.08.2020
            # 19.59
            w71 = ["@DO 17 1#", "@DO 18 1#", "@DO 23 1#", "@DO 24 1#", "@DO 25 1#", "@DO 26 1#", "@DO 27 1#", "@DO 28 1#", "@DO 29 1#", "@DO 30 1#", "@DO 31 1#", "@DO 32 1#", "@DO 33 1#"]
            w72 = ["@DO 54 1#", "@DO 55 1#", "@DO 56 1#", "@DO 57 1#", "@DO 58 1#", "@DO 59 1#", "@DO 60 1#", "@DO 61 1#"]
            Insert Into Array(inArray=w71, new=w72) -> w73
            call "CMD_Iteration.gvi"(VISA_IN=w52, ARRAY_IN=w73, ERROR_IN=w53) -> (VISA Answer=w55, ERROR_OUT=w54)
          }
          frame "Parallel 4 Diode" {
            # @DO 17 1#
            # @DO 18 1#
            # @DO 23 1#
            # @DO 24 1#
            # @DO 25 1#
            # @DO 26 1#
            # @DO 27 1#
            # @DO 28 1#
            # @DO 29 1#
            # @DO 30 1#
            # @DO 31 1#
            # @DO 32 1#
            # @DO 33 1#
            # 03.08.2020
            # 20.00
            w74 = ["@DO 17 1#", "@DO 18 1#", "@DO 23 1#", "@DO 24 1#", "@DO 25 1#", "@DO 26 1#", "@DO 27 1#", "@DO 28 1#", "@DO 29 1#", "@DO 30 1#", "@DO 31 1#", "@DO 32 1#", "@DO 33 1#"]
            # @DO 54 0#
            # @DO 55 0#
            # @DO 56 0#
            # @DO 57 0#
            #
            # 03.08.2020
            # 20.00
            w75 = ["@DO 54 0#", "@DO 55 0#", "@DO 56 0#", "@DO 57 0#", "@DO 58 1#", "@DO 59 1#", "@DO 60 1#", "@DO 61 1#"]
            Insert Into Array(inArray=w74, new=w75) -> w76
            call "CMD_Iteration.gvi"(VISA_IN=w52, ARRAY_IN=w76, ERROR_IN=w53) -> (VISA Answer=w55, ERROR_OUT=w54)
          }
          frame "Series 4" {
            # @DO 17 0#
            # @DO 18 1#
            # @DO 23 0#
            # @DO 24 1#
            # @DO 25 1#
            # @DO 26 0#
            # @DO 27 0#
            # @DO 28 0#
            # @DO 29 0#
            # @DO 30 0#
            # @DO 31 0#
            # @DO 32 0#
            # @DO 33 0#
            #
            # 03.08.2020
            # 20.02
            w77 = ["@DO 17 0#", "@DO 18 1#", "@DO 23 0#", "@DO 24 1#", "@DO 25 1#", "@DO 26 0#", "@DO 27 0#", "@DO 28 0#", "@DO 29 0#", "@DO 30 0#", "@DO 31 0#", "@DO 32 0#", "@DO 33 0#"]
            w78 = ["@DO 54 1#", "@DO 55 1#", "@DO 56 1#", "@DO 57 1#", "@DO 58 1#", "@DO 59 1#", "@DO 60 1#", "@DO 61 1#"]
            Insert Into Array(inArray=w77, new=w78) -> w79
            call "CMD_Iteration.gvi"(VISA_IN=w52, ARRAY_IN=w79, ERROR_IN=w53) -> (VISA Answer=w55, ERROR_OUT=w54)
          }
          frame "Series 4 Diode" {
            # @DO 17 0#
            # @DO 18 1#
            # @DO 23 0#
            # @DO 24 1#
            # @DO 25 1#
            # @DO 26 0#
            # @DO 27 0#
            # @DO 28 0#
            # @DO 29 0#
            # @DO 30 0#
            # @DO 31 0#
            # @DO 32 0#
            # @DO 33 0#
            #
            # 03.08.2020
            # 20.03
            w80 = ["@DO 17 0#", "@DO 18 1#", "@DO 23 0#", "@DO 24 1#", "@DO 25 1#", "@DO 26 0#", "@DO 27 0#", "@DO 28 0#", "@DO 29 0#", "@DO 30 0#", "@DO 31 0#", "@DO 32 0#", "@DO 33 0#"]
            # @DO 58 0#
            # @DO 59 0#
            # @DO 60 0#
            # @DO 61 0#
            #
            # 03.08.2020
            # 20.04
            w81 = ["@DO 54 1#", "@DO 55 1#", "@DO 56 1#", "@DO 57 1#", "@DO 58 0#", "@DO 59 0#", "@DO 60 0#", "@DO 61 0#"]
            Insert Into Array(inArray=w80, new=w81) -> w82
            call "CMD_Iteration.gvi"(VISA_IN=w52, ARRAY_IN=w82, ERROR_IN=w53) -> (VISA Answer=w55, ERROR_OUT=w54)
          }
          frame "Parallel Of Series" {
            # @DO 17 1#
            # @DO 18 1#
            # @DO 23 1#
            # @DO 24 1#
            # @DO 25 1#
            # @DO 26 1#
            # @DO 27 0#
            # @DO 28 1#
            # @DO 29 0#
            # @DO 30 0#
            # @DO 31 1#
            # @DO 32 0#
            # @DO 33 1#
            #
            # 03.08.2020
            # 20.05
            w83 = ["@DO 17 1#", "@DO 18 1#", "@DO 23 1#", "@DO 24 1#", "@DO 25 1#", "@DO 26 1#", "@DO 27 0#", "@DO 28 1#", "@DO 29 0#", "@DO 30 0#", "@DO 31 1#", "@DO 32 0#", "@DO 33 1#"]
            w84 = ["@DO 54 1#", "@DO 55 1#", "@DO 56 1#", "@DO 57 1#", "@DO 58 1#", "@DO 59 1#", "@DO 60 1#", "@DO 61 1#"]
            Insert Into Array(inArray=w83, new=w84) -> w85
            call "CMD_Iteration.gvi"(VISA_IN=w52, ARRAY_IN=w85, ERROR_IN=w53) -> (VISA Answer=w55, ERROR_OUT=w54)
          }
          frame "Parallel Of Series Diode" {
            # @DO 17 1#
            # @DO 18 1#
            # @DO 23 1#
            # @DO 24 1#
            # @DO 25 1#
            # @DO 26 1#
            # @DO 27 0#
            # @DO 28 1#
            # @DO 29 0#
            # @DO 30 0#
            # @DO 31 1#
            # @DO 32 0#
            # @DO 33 1#
            #
            # 03.08.2020
            # 20.06
            # @DO 58 0#
            # @DO 59 0#
            # @DO 60 0#
            # @DO 61 0#
            #
            # 03.08.2020
            # 20.097
            w86 = ["@DO 17 1#", "@DO 18 1#", "@DO 23 1#", "@DO 24 1#", "@DO 25 1#", "@DO 26 1#", "@DO 27 0#", "@DO 28 1#", "@DO 29 0#", "@DO 30 0#", "@DO 31 1#", "@DO 32 0#", "@DO 33 1#"]
            w87 = ["@DO 54 1#", "@DO 55 1#", "@DO 56 1#", "@DO 57 1#", "@DO 58 0#", "@DO 59 0#", "@DO 60 0#", "@DO 61 0#"]
            Insert Into Array(inArray=w86, new=w87) -> w88
            call "CMD_Iteration.gvi"(VISA_IN=w52, ARRAY_IN=w88, ERROR_IN=w53) -> (VISA Answer=w55, ERROR_OUT=w54)
          }
          frame "Series Of Parallel" {
            w89 = ["@DO 54 1#", "@DO 55 1#", "@DO 56 1#", "@DO 57 1#", "@DO 58 1#", "@DO 59 1#", "@DO 60 1#", "@DO 61 1#"]
            # @DO 17 1#
            # @DO 18 0#
            # @DO 23 0#
            # @DO 24 0#
            # @DO 25 0#
            # @DO 26 1#
            # @DO 27 1#
            # @DO 28 1#
            # @DO 29 1#
            # @DO 30 1#
            # @DO 31 1#
            # @DO 32 1#
            # @DO 33 1#
            #
            # 03.08.2020
            # 20.07
            w90 = ["@DO 17 1#", "@DO 18 0#", "@DO 23 0#", "@DO 24 0#", "@DO 25 0#", "@DO 26 1#", "@DO 27 1#", "@DO 28 1#", "@DO 29 1#", "@DO 30 1#", "@DO 31 1#", "@DO 32 1#", "@DO 33 1#"]
            Insert Into Array(inArray=w90, new=w89) -> w91
            call "CMD_Iteration.gvi"(VISA_IN=w52, ARRAY_IN=w91, ERROR_IN=w53) -> (VISA Answer=w55, ERROR_OUT=w54)
          }
          frame "Series Of Parallel Diode" {
            # @DO 17 1#
            # @DO 18 0#
            # @DO 23 0#
            # @DO 24 0#
            # @DO 25 0#
            # @DO 26 1#
            # @DO 27 1#
            # @DO 28 1#
            # @DO 29 1#
            # @DO 30 1#
            # @DO 31 1#
            # @DO 32 1#
            # @DO 33 1#
            #
            # 03.08.2020
            # 20.08
            w92 = ["@DO 17 1#", "@DO 18 0#", "@DO 23 0#", "@DO 24 0#", "@DO 25 0#", "@DO 26 1#", "@DO 27 1#", "@DO 28 1#", "@DO 29 1#", "@DO 30 1#", "@DO 31 1#", "@DO 32 1#", "@DO 33 1#"]
            # @DO 54 0#
            # @DO 55 0#
            # @DO 56 0#
            # @DO 57 0#
            #
            # 20.09
            # 03.08.2020
            w93 = ["@DO 54 0#", "@DO 55 0#", "@DO 56 0#", "@DO 57 0#", "@DO 58 1#", "@DO 59 1#", "@DO 60 1#", "@DO 61 1#"]
            Insert Into Array(inArray=w92, new=w93) -> w94
            call "CMD_Iteration.gvi"(VISA_IN=w52, ARRAY_IN=w94, ERROR_IN=w53) -> (VISA Answer=w55, ERROR_OUT=w54)
          }
        }
        call "PV_switch.gvi"(VISA_IN=w49, CTRL="Connect", ERROR_IN=w54) -> (ERROR_OUT=w18)
        $"VISA Answer" <- w55
        w19 = s2
        w20 = default
      }
      frame "Reset CVM" {
        Property Node(instance in=s3) -> ("VISA Resource"=w95, instance out=w21)
        # VOLTAGE RANGE
        # @DO 51 0#
        # @DO 52 0#
        # @DO 53 0#
        # CURRENT RANGE
        # @DO 50 1#
        call "CMD_Iteration.gvi"(VISA_IN=w95, ARRAY_IN=["@DO 51 1#", "@DO 52 1#", "@DO 53 1#"], ERROR_IN=w17) -> (VISA_OUT=w96, ERROR_OUT=w97)
        call "CMD_Iteration.gvi"(VISA_IN=w96, ARRAY_IN=["@DO 50 1#"], ERROR_IN=w97) -> (ERROR_OUT=w18)
        $"Voltage coeff" <- 1
        $"Current coeff" <- 1
        w19 = s2
        w20 = default
      }
      frame "VAC" {
        w98 = ["0", "1,", "10,", "20,10,", "50,", "50,20,", "100,", "100,40,10,", "200,100,", "500,100,", "1000,", "2000,", "2000,1000,", "4000,", "4000,1000,", "4000,2000,", "4000,2000,1000,", "4000,2000,1000,500,400,100,"]
        Array Size(array=w98) -> (size(s)=w99)
        Is Less Or Equal(x=$"VAC Load Counter", y=w99) -> w100
        Property Node(instance in=s3) -> ("VISA Resource"=w101, "Physical Channel"=w102, instance out=w21)
        Variant To Data(type=timestamp 1904-01-01T00:00:00Z, variant=w16) -> (data=w103)
        Get Current Time() -> (current time=w104)
        Timestamp Subtract(x=w104, y=w103) -> w105
        Is Greater Or Equal(x=w105, y=5) -> w106
        Logical And(w106, w100) -> w107
        call "DAQmx Read (Analog 2D DBL NChan NSamp).gvi"(task in=w102, number of samples per channel=1) -> (data=w108)
        Array Index(array=w108) -> (out0[1, 0]=w109)
        Multiply(w109, 4) -> w110
        Feedback Node(input=w111) -> w112
        Build Array(w112, w110) -> w111
        Array Index(array=w108) -> (out0[0, 0]=w113)
        Divide(x=w113, y=70) -> w114
        Multiply(w114, 1000) -> w115
        Feedback Node(input=w116) -> w117
        Build Array(w117, w115) -> w116
        Build Cluster(w111, w116) -> w118
        case (w107) {
          frame False, Default {
            w119 = w17
            w120 = w103
            w121 = $"VAC Load Counter"
          }
          frame True {
            Get Current Time() -> (current time=w120)
            # Disconnect ALL load
            Array Index(array=w98) -> (out0[$"VAC Load Counter"]=w122)
            w123 = ["@DO 42 1#", "@DO 34 0#", "@DO 35 0#", "@DO 36 0#", "@DO 37 0#", "@DO 38 0#", "@DO 39 0#", "@DO 40 0#", "@DO 41 0#", "@DO 43 0#", "@DO 44 0#", "@DO 45 0#", "@DO 46 0#", "@DO 47 0#", "@DO 48 0#", "@DO 49 0#"]
            call "CMD_Iteration.gvi"(VISA_IN=w101, ARRAY_IN=w123, ERROR_IN=w17) -> (ERROR_OUT=w124)
            s4 = w122  # shift register
            while {
              Match Pattern(regular expression=",", string=s4) -> (after substring=w125, before substring=w126)
              case (w126) {
                frame "1", Default {
                  call "Read_Write_VISA.gvi"(VISA_IN=w101, CMD="@DO 43 1#", ERROR_IN=w124) -> (ERROR_OUT=w127)
                }
                frame "2" {
                  call "Read_Write_VISA.gvi"(VISA_IN=w101, CMD="@DO 44 1#", ERROR_IN=w124) -> (ERROR_OUT=w127)
                }
                frame "3" {
                  call "Read_Write_VISA.gvi"(VISA_IN=w101, CMD="@DO 45 1#", ERROR_IN=w124) -> (ERROR_OUT=w127)
                }
                frame "5" {
                  call "Read_Write_VISA.gvi"(VISA_IN=w101, CMD="@DO 46 1#", ERROR_IN=w124) -> (ERROR_OUT=w127)
                }
                frame "10" {
                  call "Read_Write_VISA.gvi"(VISA_IN=w101, CMD="@DO 47 1#", ERROR_IN=w124) -> (ERROR_OUT=w127)
                }
                frame "20" {
                  call "Read_Write_VISA.gvi"(VISA_IN=w101, CMD="@DO 48 1#", ERROR_IN=w124) -> (ERROR_OUT=w127)
                }
                frame "40" {
                  call "Read_Write_VISA.gvi"(VISA_IN=w101, CMD="@DO 49 1#", ERROR_IN=w124) -> (ERROR_OUT=w127)
                }
                frame "50" {
                  call "Read_Write_VISA.gvi"(VISA_IN=w101, CMD="@DO 34 1#", ERROR_IN=w124) -> (ERROR_OUT=w127)
                }
                frame "100" {
                  call "Read_Write_VISA.gvi"(VISA_IN=w101, CMD="@DO 35 1#", ERROR_IN=w124) -> (ERROR_OUT=w127)
                }
                frame "200" {
                  call "Read_Write_VISA.gvi"(VISA_IN=w101, CMD="@DO 36 1#", ERROR_IN=w124) -> (ERROR_OUT=w127)
                }
                frame "400" {
                  call "Read_Write_VISA.gvi"(VISA_IN=w101, CMD="@DO 37 1#", ERROR_IN=w124) -> (ERROR_OUT=w127)
                }
                frame "500" {
                  call "Read_Write_VISA.gvi"(VISA_IN=w101, CMD="@DO 38 1#", ERROR_IN=w124) -> (ERROR_OUT=w127)
                }
                frame "1000" {
                  call "Read_Write_VISA.gvi"(VISA_IN=w101, CMD="@DO 39 1#", ERROR_IN=w124) -> (ERROR_OUT=w127)
                }
                frame "2000" {
                  call "Read_Write_VISA.gvi"(VISA_IN=w101, CMD="@DO 40 1#", ERROR_IN=w124) -> (ERROR_OUT=w127)
                }
                frame "4000" {
                  call "Read_Write_VISA.gvi"(VISA_IN=w101, CMD="@DO 41 1#", ERROR_IN=w124) -> (ERROR_OUT=w127)
                }
                frame "0" {
                  # Для измерения тока К.З.
                  # Схема сопротивления
                  # 1 Ом + 1 Ом токовый резистор
                  w127 = w124
                }
              }
              Is Empty String Or Path(string/path=w125) -> w128
              next s4 = w125
              stop if w128
            }
            call "Read_Write_VISA.gvi"(VISA_IN=w101, CMD="@DO 42 0#", ERROR_IN=w127) -> (ERROR_OUT=w119)
            Increment(x=$"VAC Load Counter") -> w121
            $Graph_3 <- w118
          }
        }
        call "Enqueue Message (Single).gvi"(message queue in=w14, message="Watchdog", error in=w119) -> (error out=w129)
        case (w100) {
          frame False, Default {
            w18 = w129
          }
          frame True {
            call "Enqueue Message (Single).gvi"(message queue in=w14, message="VAC", message data=w120, error in=w129) -> (error out=w18)
          }
        }
        $"VAC Load Counter" <- w121
        w19 = s2
        w20 = default
      }
      frame "Prepare CVM" {
        Property Node(instance in=s3) -> ("VISA Resource"=w130, "Physical Channel"=w131, instance out=w21)
        call "DAQmx Read (Analog 2D DBL NChan NSamp).gvi"(task in=w131, error in=w17, number of samples per channel=1) -> (error out=w132, data=w133)
        Array Index(array=w133) -> (out0[2, 0]=w134)
        Multiply(w134, 4) -> w135
        C Code Node("x"=w135) -> ("y"=w136, Error Out=w137)
        ~~~
        if(x>-1 && x<=1)
          y = 0;
        if(x>1 && x<=10)
          y = 1;
        if(x>10 && x<=20)
          y = 2;
        if(x>20 && x<=30)
          y = 3;
        ~~~
        $"Voltage Range" <- w136
        # Voltage Range
        case (w136) {
          frame 0, Default {
            call "CMD_Iteration.gvi"(VISA_IN=w130, ARRAY_IN=["@DO 51 1#", "@DO 52 1#", "@DO 53 0#"], ERROR_IN=w137) -> (VISA Answer=w140, ERROR_OUT=w138)
            w139 = 0.1
          }
          frame 1 {
            call "CMD_Iteration.gvi"(VISA_IN=w130, ARRAY_IN=["@DO 51 1#", "@DO 52 1#", "@DO 53 1#"], ERROR_IN=w137) -> (VISA Answer=w140, ERROR_OUT=w138)
            w139 = 1
          }
          frame 2 {
            call "CMD_Iteration.gvi"(VISA_IN=w130, ARRAY_IN=["@DO 51 1#", "@DO 52 0#", "@DO 53 1#"], ERROR_IN=w137) -> (VISA Answer=w140, ERROR_OUT=w138)
            w139 = 0.5
          }
          frame 3 {
            # Div x0.25 works with 2 relay
            call "CMD_Iteration.gvi"(VISA_IN=w130, ARRAY_IN=["@DO 51 0#\n"], ERROR_IN=w137) -> (VISA Answer=w140, ERROR_OUT=w138)
            w139 = 0.25
          }
        }
        $"Voltage coeff" <- w139
        $"VISA Answer_2" <- w140
        Array Index(array=w133) -> (out0[3, 0]=w141)
        # Tip For Local Wiring Solution
        # Relay 1(50) 	DO 1- REP A x1
        # 		DO 0- AMP A x10
        #
        # Relay 2(51) 	DO 1-REP V x1
        # 		DO 0-DIV V x0.25
        # Relay 3(52) 	DO 1-REP V x1
        # 		DO 0-DIV V x0.5
        # Relay 4(53) 	DO 1-REP V x1
        # 		DO 0-AMP V x10
        C Code Node("x"=w141) -> ("y"=w142)
        ~~~
        if(x>-1 && x<=0.6)
          y = 0;
        if(x>0.6 && x<=6)
          y = 1;
        ~~~
        # Current Range
        case (w142) {
          frame 0, Default {
            call "CMD_Iteration.gvi"(VISA_IN=w130, ARRAY_IN=["@DO 50 0#"]) -> (ERROR_OUT=w143)
            w144 = 0.1
          }
          frame 1 {
            call "CMD_Iteration.gvi"(VISA_IN=w130, ARRAY_IN=["@DO 50 1#"]) -> (ERROR_OUT=w143)
            w144 = 1
          }
        }
        $"Current coeff" <- w144
        Merge Errors(w138, w143, w132) -> (error out=w18)
        w19 = s2
        w20 = default
      }
      frame "Fans Control" {
        Variant To Data(error in (no error)=w17, type=string "", variant=w16) -> (data=w145, error out=w146)
        Property Node(instance in=s3) -> ("VISA Resource"=w147, instance out=w21)
        case (w145) {
          frame "Turn All Off", Default {
            w148 = ["@PWM 7 0#", "@PWM 8 0#"]
          }
          frame "Turn All On" {
            w148 = ["@DO 7 1#", "@DO 8 1#"]
          }
          frame "Turn 1,2 On" {
            w148 = ["@DO 7 1#", "@DO 8 0#", ""]
          }
          frame "Turn 3,4 On" {
            w148 = ["@DO 8 1#", "@DO 7 0#"]
          }
        }
        call "CMD_Iteration.gvi"(VISA_IN=w147, ARRAY_IN=w148, ERROR_IN=w146) -> (ERROR_OUT=w149)
        case (w149) {
          frame Error, Default {
            w18 = w149
          }
          frame No Error {
            w18 = w149
          }
        }
        w19 = s2
        w20 = default
      }
      frame "Set Time" {
        Property Node(instance in=s3) -> ("VISA Resource"=w150, instance out=w21)
        Variant To Data(error in (no error)=w17, type=string "", variant=w16) -> (data=w151, error out=w152)
        case (w151) {
          frame "Turn All Off", Default {
            w153 = ["@DO 7 1#", "@DO 8 1#"]
          }
          frame "Turn All On" {
            w153 = ["@DO 7 0#", "@DO 8 0#"]
          }
          frame "Turn 1,2 On" {
            w153 = ["@DO 7 1#", "@DO 8 0#", ""]
          }
          frame "Turn 3,4 On" {
            w153 = ["@DO 8 1#", "@DO 7 0#"]
          }
        }
        call "CMD_Iteration.gvi"(VISA_IN=w150, ARRAY_IN=w153, ERROR_IN=w152) -> (ERROR_OUT=w18)
        # Послать команду Settime
        #
        # Лучше всего посылать время, но если не выйдет- слово
        disable {
          frame Enabled { }
          frame Disabled {
            Get Current Time()
          }
        }
        w19 = s2
        w20 = default
      }
      frame "Optic Filter Config" {
        Property Node(instance in=s3) -> ("VISA Resource"=w154, instance out=w21)
        Variant To Data(error in (no error)=w17, type=string "", variant=w16) -> (data=w155, error out=w156)
        case (w155) {
          frame "None", Default {
            w157 = ["@SERV 3 90#", "@SERV 4 0#"]
          }
          frame "Filter 1" {
            w157 = ["@SERV 3 90#", "@SERV 4 0#", "@SERV 3 0#"]
          }
          frame "Filter 2" {
            w157 = ["@SERV 3 90#", "@SERV 4 0#", "@SERV 4 90#"]
          }
        }
        call "CMD_Iteration.gvi"(VISA_IN=w154, ARRAY_IN=w157, ERROR_IN=w156) -> (ERROR_OUT=w18)
        w19 = s2
        w20 = default
      }
      frame "Set PV Angle" {
        Property Node(instance in=s3) -> ("VISA Resource"=w158, instance out=w21)
        Variant To Data(error in (no error)=w17, type=u32 0, variant=w16) -> (data=w159, error out=w160)
        # Set angle limits for PV panels
        In Range And Coerce(lower limit=0, upper limit=180, x=w159) -> (coerced(x)=w161)
        Number To Decimal String(number=w161) -> (decimal integer string=w162)
        Concatenate Strings("@SERV 13 ", w162, " #") -> w163
        call "Read_Write_VISA.gvi"(VISA_IN=w158, CMD=w163, ERROR_IN=w160) -> (ERROR_OUT=w18)
        w19 = s2
        w20 = default
      }
      frame "Brightness Config" {
        Property Node(instance in=s3) -> ("VISA Resource"=w164, instance out=w21)
        Variant To Data(error in (no error)=w17, type=u32 0, variant=w16) -> (data=w165, error out=w166)
        # Set brightness limits
        In Range And Coerce(lower limit=0, upper limit=100, x=w165) -> (coerced(x)=w167)
        Number To Decimal String(number=w167) -> (decimal integer string=w168)
        Concatenate Strings("@DIM 6 ", w168, " #") -> w169
        call "Read_Write_VISA.gvi"(VISA_IN=w164, CMD=w169, ERROR_IN=w166) -> (ERROR_OUT=w18)
        w19 = s2
        w20 = default
      }
      frame "IR Thermometer" {
        Property Node(instance in=s3) -> ("VISA Resource"=w170, instance out=w21)
        Variant To Data(error in (no error)=w17, type=string "", variant=w16) -> (data=w171, error out=w172)
        case (w171) {
          frame "None", Default {
            w173 = "@SERV 5 0#"
          }
          frame "Panel 1" {
            w173 = "@SERV 5 50#"
          }
          frame "Panel 2" {
            w173 = "@SERV 5 90#"
          }
          frame "Panel 3" {
            w173 = "@SERV 5 120#"
          }
          frame "Panel 4" {
            w173 = "@SERV 5 150#"
          }
        }
        call "Read_Write_VISA.gvi"(VISA_IN=w170, CMD=w173, ERROR_IN=w172) -> (ERROR_OUT=w18)
        w19 = s2
        w20 = default
      }
      frame "Set Resistance" {
        Property Node(instance in=s3) -> ("VISA Resource"=w174, instance out=w21)
        Variant To Data(error in (no error)=w17, type=string "", variant=w16) -> (data=w175, error out=w176)
        # Disconnect ALL load
        w177 = ["@DO 42 1#", "@DO 34 0#", "@DO 35 0#", "@DO 36 0#", "@DO 37 0#", "@DO 38 0#", "@DO 39 0#", "@DO 40 0#", "@DO 41 0#", "@DO 43 0#", "@DO 44 0#", "@DO 45 0#", "@DO 46 0#", "@DO 47 0#", "@DO 48 0#", "@DO 49 0#"]
        call "CMD_Iteration.gvi"(VISA_IN=w174, ARRAY_IN=w177, ERROR_IN=w176) -> (VISA_OUT=w178, ERROR_OUT=w179)
        s5 = w175  # shift register
        while {
          Match Pattern(regular expression=",", string=s5) -> (after substring=w180, before substring=w181)
          case (w181) {
            frame "1", Default {
              call "Read_Write_VISA.gvi"(VISA_IN=w178, CMD="@DO 43 1#", ERROR_IN=w179) -> (ERROR_OUT=w182)
            }
            frame "2" {
              call "Read_Write_VISA.gvi"(VISA_IN=w178, CMD="@DO 44 1#", ERROR_IN=w179) -> (ERROR_OUT=w182)
            }
            frame "3" {
              call "Read_Write_VISA.gvi"(VISA_IN=w178, CMD="@DO 45 1#", ERROR_IN=w179) -> (ERROR_OUT=w182)
            }
            frame "5" {
              call "Read_Write_VISA.gvi"(VISA_IN=w178, CMD="@DO 46 1#", ERROR_IN=w179) -> (ERROR_OUT=w182)
            }
            frame "10" {
              call "Read_Write_VISA.gvi"(VISA_IN=w178, CMD="@DO 47 1#", ERROR_IN=w179) -> (ERROR_OUT=w182)
            }
            frame "20" {
              call "Read_Write_VISA.gvi"(VISA_IN=w178, CMD="@DO 48 1#", ERROR_IN=w179) -> (ERROR_OUT=w182)
            }
            frame "40" {
              call "Read_Write_VISA.gvi"(VISA_IN=w178, CMD="@DO 49 1#", ERROR_IN=w179) -> (ERROR_OUT=w182)
            }
            frame "50" {
              call "Read_Write_VISA.gvi"(VISA_IN=w178, CMD="@DO 34 1#", ERROR_IN=w179) -> (ERROR_OUT=w182)
            }
            frame "100" {
              call "Read_Write_VISA.gvi"(VISA_IN=w178, CMD="@DO 35 1#", ERROR_IN=w179) -> (ERROR_OUT=w182)
            }
            frame "200" {
              call "Read_Write_VISA.gvi"(VISA_IN=w178, CMD="@DO 36 1#", ERROR_IN=w179) -> (ERROR_OUT=w182)
            }
            frame "400" {
              call "Read_Write_VISA.gvi"(VISA_IN=w178, CMD="@DO 37 1#", ERROR_IN=w179) -> (ERROR_OUT=w182)
            }
            frame "500" {
              call "Read_Write_VISA.gvi"(VISA_IN=w178, CMD="@DO 38 1#", ERROR_IN=w179) -> (ERROR_OUT=w182)
            }
            frame "1000" {
              call "Read_Write_VISA.gvi"(VISA_IN=w178, CMD="@DO 39 1#", ERROR_IN=w179) -> (ERROR_OUT=w182)
            }
            frame "2000" {
              call "Read_Write_VISA.gvi"(VISA_IN=w178, CMD="@DO 40 1#", ERROR_IN=w179) -> (ERROR_OUT=w182)
            }
            frame "4000" {
              call "Read_Write_VISA.gvi"(VISA_IN=w178, CMD="@DO 41 1#", ERROR_IN=w179) -> (ERROR_OUT=w182)
            }
            frame "0" {
              # Для измерения тока К.З.
              # Схема сопротивления
              # 1 Ом + 1 Ом токовый резистор
              w182 = w179
            }
          }
          Is Empty String Or Path(string/path=w180) -> w183
          next s5 = w180
          stop if w183
        }
        # Connect Load
        call "Read_Write_VISA.gvi"(VISA_IN=w174, CMD="@DO 42 0#", ERROR_IN=w182) -> (ERROR_OUT=w18)
        w19 = s2
        w20 = default
      }
      frame "Reset Resistance" {
        Property Node(instance in=s3) -> ("VISA Resource"=w184, instance out=w21)
        # Размыкаются всё реле, сопротивление- бесконечность
        w185 = ["@DO 42 1#", "@DO 34 1#", "@DO 35 1#", "@DO 36 1#", "@DO 37 1#", "@DO 38 1#", "@DO 39 1#", "@DO 40 1#", "@DO 41 1#", "@DO 43 1#", "@DO 44 1#", "@DO 45 1#", "@DO 46 1#", "@DO 47 1#", "@DO 48 1#", "@DO 49 1#"]
        # Сопротивление в начальное положение
        call "CMD_Iteration.gvi"(VISA_IN=w184, ARRAY_IN=w185, ERROR_IN=w17) -> (ERROR_OUT=w18)
        w19 = s2
        w20 = default
      }
      frame "Watchdog" {
        Property Node(instance in=s3) -> ("Physical Channel"=w186, "VISA Resource"=w187, instance out=w21)
        call "DAQmx Read (Analog 2D DBL NChan NSamp).gvi"(task in=w186, number of samples per channel=1) -> (data=w188)
        Array Index(array=w188) -> (out0[1, 0]=w189)
        Multiply(w189, 4) -> w190
        Multiply(w190, $"Voltage coeff") -> w191
        Feedback Node(input=w192) -> w193
        Build Array(w193, w191) -> w192
        $Voltage_Graph <- w192
        $V_real <- w191
        Array Index(array=w188) -> (out0[0, 0]=w194)
        Divide(x=w194, y=70) -> w195
        Multiply(w195, 1000) -> w196
        Multiply(w196, $"Current coeff") -> w197
        $Current_real <- w197
        call "Read_Write_VISA.gvi"(VISA_IN=w187, CMD="@LUX 10 1#", ERROR_IN=w17) -> (OUTPUT=w198, TAG=w199, ERROR_OUT=w200)
        $LUX_2 <- w199
        call "Read_Write_VISA.gvi"(VISA_IN=w198, CMD="@TEMP 12 0#", ERROR_IN=w200) -> (TAG=w201, ERROR_OUT=w202)
        $TEMP_2 <- w201
        call "DAQmx Read (Analog 1D Wfm NChan NSamp).gvi"(task in=w186, error in=w202, number of samples per channel=1) -> (error out=w203, data=w204)
        $Chart <- w204
        Feedback Node(input=w205) -> w206
        Build Array(w206, w197) -> w205
        $Current_Graph <- w205
        call "Enqueue Message (Single).gvi"(message queue in=w14, message="Wait For Event", error in=w203) -> (error out=w18)
        w19 = s2
        w20 = default
      }
      frame "Error" {
        Variant To Data(error in (no error)=w17, type=no error, variant=w16) -> (data=w207, error out=w18)
        # #CodeRecommended - If you ever change the name of this "Error" message, you'll need to update the name in the Check Loop Error.vi as well.
        call "Display Error.gvi"(error in=w207)
        w19 = s2
        w20 = default
        w21 = s3
      }
      frame "Exit" {
        Generate User Event(event data=TRUE, user event=w3) -> (error out=w208)
        Release Queue(error in=w17, queue=w14) -> (error out=w209)
        Property Node(instance in=s3) -> ("VISA Resource"=w210, "Physical Channel"=w211, "tag"=w212, "configuration"=w213)
        call "Close Configuration.gvi"(configuration=w213) -> (error out=w214)
        call "Close Tag (Single).gvi"(tag=w212, error in=w214) -> (error out=w215)
        call "DAQmx Stop Task.gvi"(task in=w211, error in=w215) -> (error out=w216)
        call "Close (Instr).gvi"(session in=w210, error in=w216) -> (error out=w217)
        Merge Errors(w217, w208, w209) -> (error out=w18)
        w19 = s2
        w20 = TRUE
        w21 = default
      }
      frame Default {
        w218 = "The invalid message string \"%s\" was received in the Message Handling Loop."
        Format Into String(formatString=w218, w15) -> w219
        call "Build Error Cluster.gvi"(code=1, description=w219) -> (error out=w18)
        w19 = s2
        w20 = default
        w21 = s3
      }
    }
    call "Error Handler - Message Handling Loop.gvi"(message queue in=w14, error in=w18) -> (dup error in=w220)
    $Output <- w18
    next s2 = w19
    next s3 = w21
    stop if w20
  }
  disable {
    frame Enabled { }
    frame Disabled {
      call "Initialize.gvi"(device name="cam0") -> (session out=w221, error out=w222)
      call "Configure Grab.gvi"(session in=w221, error in=w222) -> (session out=w223, error out=w224)
      call "Create Image.gvi"(image name="image_1") -> (new image=w225)
      while {
        call "Grab.gvi"(session in=w223, error in=w224, image in=w225) -> (session out=w226, error out=w227)
        stop if $Stop
      }
      call "Close.gvi"(session=w226, error in=w227)
    }
  }
